vi "FSKRxProject.gvi"   [LabVIEW Communications System Design Software 2.0.1]
panel controls:
  "IQ rate": f64 = 31200
  "carrier frequency": f64 = 915000000
  "gain (dB)": f64
  "active antenna": string = "RX2"
  "symbol rate (sym/s)": i64 = 780
  "adc.m path": path = path "C:\\Users\\Emirhan Garip\\Desktop\\Telecom Proje\\EE3001_FinalProject(NC_YC_EA)\\MATLAB Files"
  "niUSRP Device": "niUSRPClass"
  "HEAR PLUS PRO MAX +": bool = TRUE
  "Control": bool
panel indicators:
  "actual IQ rate": f64
  "actual carrier frequency": f64
  "actual gain (dB)": f64
  "Baseband Output": cluster{"t0": f64, "dt": f64, "Y": f64[]}
  "Eye Diagram": cluster{"t0": f64, "dt": f64, "Y": f64[]}[]
  "millisecond timer value": u32
  "Graph": f64[]
  "framesync_2": i16[]
  "son_3": i16[]
  "raw_2": f64[]
  "BER": f64
  "Power Spectrum of Test Signal /wFBDG (only in test mode)": T1
  "Power Spectrum of Test Signal (only in test mode)": T1
  "Power Spectrum of Test Signal /wFBDG": T1
  "Power Spectrum of Test Signal": T1
types:
  T1 = cluster{"f0": f64, "df": f64, "magnitude": f64[]}
  "Sound Data Format.gtype" = cluster{"sample rate (S/s)": f64, "number of channels": i32, "bits per sample": i32}
uses:
  NI::Analysis::Conditioning::Unwrap Phase.gvi
  NI::Analysis::Operations::1D Convolution (DBL).gvi
  NI::Analysis::Resampling::Decimate (single shot, DBL).gvi
diagram:
  call "niUSRP Open Rx Session.gvi"(niUSRP Device=$"niUSRP Device", reset=TRUE) -> (error out=w1, session handle out=w2)
  call "niUSRP Configure Signal.gvi"(session handle=w2, IQ rate=$"IQ rate", carrier frequency=$"carrier frequency", gain=$"gain (dB)", error in (no error)=w1, active antenna=$"active antenna") -> (session handle out=w3, coerced IQ rate=w4, coerced carrier frequency=w5, coerced gain=w6, Error Out=w7)
  call "niUSRP Initiate.gvi"(session handle=w3, error in (no error)=w7) -> (session handle out=w8, Error Out=w9)
  # samples/symbol = Decimation Factor
  w10 = $"adc.m path"
  # Upsampling
  # Pulse Shaping
  while {
    To Double Precision Float(number=$"symbol rate (sym/s)") -> w11
    Divide(x=w4, y=w11) -> w12
    To Long Integer(number=w12) -> w13
    Add(26, 78) -> w14
    Multiply(w14, w12) -> w15
    Multiply(2, w15) -> w16
    To Quad Integer(number=w16) -> w17
    call "niUSRP Fetch Rx Data (CDB Cluster).gvi"(session handle=w8, number of samples=w17, error in (no error)=w9) -> (session handle out=w18, data=w19, Error Out=w20)
    Property Node(instance in=w19) -> ("dt"=w21, "Y"=w22)
    To Long Integer(number=w12) -> w23
    call "MT Generate Filter Coefficients.gvi"(pulse shaping filter="Root Raised Cos", matched samples per symbol=w23, modulation type="FSK") -> (matched filter coefficients=w24)
    # no. samples
    Complex To Polar(r * e^(i*theta)=w22) -> (theta=w25)
    call "Unwrap Phase.gvi"(input phase=w25, phase unit="degree in, radian out"(3)) -> (unwrapped phase=w26)
    call "FIR Filter (DBL).gvi"(x=w26, FIR coefficients=[1, -1]) -> (filtered x=w27)
    call "Median Filter2.gvi"(X=w27, left rank=10) -> (Filtered X=w28)
    call "1D Convolution (DBL).gvi"(x=w28, y=w24) -> (x * y=w29)
    w30 = cluster{"t0": f64, "dt": f64, "Y": f64[]} {all zero or empty}
    Property Node(instance in=w30, "dt"=w21, "Y"=w29) -> (instance out=w31)
    call "PulseAlign(real).gvi"(Input Signal=w31, Receiver Sampling Factor=w13) -> (Aligned Signal=w32)
    Property Node(instance in=w32) -> ("Y"=w33)
    call "Decimate (single shot, DBL).gvi"(input array=w33, decimating factor=w13) -> (decimated array=w34)
    call "Quick Scale 1D.gvi"(X=w34) -> (Y[i]=X[i]/Max|X|=w35)
    $raw_2 <- w35
    $"Baseband Output" <- w31
    To Double Precision Float(number=0) -> w36
    To Double Precision Float(number=w13) -> w37
    call "FrameSync(Real).gvi"(Sampled Input=w35, Receiver Sampling Factor=w37) -> (Aligned Samples=w38)
    Is Greater(x=w38, y=w36) -> w39
    Boolean To Integer(Boolean=w39) -> (0, 1=w40)
    $framesync_2 <- w40
    To Long Integer(number=78) -> w41
    Array Subset(array=w40, index0=0, length0=w41) -> w42
    $son_3 <- w42
    To Double Precision Float(number=w42) -> w43
    Math Node("binary_data"=w43) -> ("final_output"=w44)
    ~~~
    % --- Step 2: Reshape into 3-bit groups (Mx3 matrix) ---
    binary_matrix = reshape(binary_data, 3, [])'; % Transpose to get Mx16

    % --- Step 3: Convert each 16-bit row to decimal (big-endian) ---
    decimal_values = zeros(size(binary_matrix, 1), 1); % Preallocate output

    for i = 1:size(binary_matrix, 1)
        % Get the 3 bits for the current sample (no flipping)
        bits = binary_matrix(i, :);

        % Convert binary to decimal (weights: 2^3 to 2^0)
        dec = sum(bits .* (2.^(2:-1:0)));

        decimal_values(i) = dec;
    end

    % --- Step 4: Output the result ---
    final_output = (decimal_values)+1; % For the example, this will be [60]
    ~~~
    $Graph <- w44
    To Double Precision Float(number=$"symbol rate (sym/s)") -> w45
    Build Waveform Node(Y=w29, dt=w21, t0=1904-01-01T00:00:00Z) -> (output waveform=w46)
    call "MT Format Eye Diagram (WDT).gvi"(waveform=w46, symbol rate=w45, eye length=2) -> (eye diagram=w47)
    $"Eye Diagram" <- w47
    Path To String(path=w10) -> (string=w48)
    Concatenate Strings(w48, "\\ear_thresholds2.txt") -> w49
    String To Path(string=w49) -> (path=w50)
    # Reading the original bitstream without error
    # Reading the original bitstream without error
    while {
      Open Or Create Or Replace File(file path (use dialog)=w50) -> (error out=w51)
      call "Is Error.gvi"(error in=w51) -> (is error?=w52)
      Not(x=w52) -> w53
      stop if w53
    }
    call "Read from Spreadsheet File (DBL).gvi"(file path=w50) -> (all rows=w54)
    Array Index(array=w54) -> (out0[_, 0]=w55)
    To Double Precision Float(number=w42) -> w56
    Subtract(x=w55, y=w56) -> w57
    Absolute Value(x=w57) -> w58
    Add Array Elements(numeric array=w58) -> (sum=w59)
    Array Size(array=w55) -> (size(s)=w60)
    To Double Precision Float(number=w60) -> w61
    Divide(x=w59, y=w61) -> w62
    $BER <- w62
    stop if w53
  }
  case ($Control) {
    frame False, Default {
      Path To String(path=w10) -> (string=w63)
      Concatenate Strings(w63, "\\multi_tone_signal.txt") -> w64
      String To Path(string=w64) -> (path=w65)
      # Reading the original bitstream without error
      # Reading the original bitstream without error
      while {
        Open Or Create Or Replace File(file path (use dialog)=w65) -> (error out=w66)
        call "Is Error.gvi"(error in=w66) -> (is error?=w67)
        Not(x=w67) -> w68
        stop if w68
      }
      call "Read from Spreadsheet File (DBL).gvi"(file path=w65) -> (all rows=w69)
      Array Index(array=w69) -> (out0[_, 0]=w70)
      call "FilterBankDynamicGain_EU.gvi"(characteristics=w44, signal=w70) -> (out=w71)
      Divide(x=w71, y=32769) -> w72
      Build Waveform Node(Y=w72) -> (output waveform=w73)
      Build Array(w73) -> w74
      w75 = "Sound Data Format.gtype" {"sample rate (S/s)"=22050, "number of channels"=1, "bits per sample"=16}
      # Playing the sounds
      call "Sound Output Configure.gvi"(device ID=0, sound format=w75, number of samples/ch=22050) -> (task ID=w76, error out=w77)
      call "Sound Output Start.gvi"(task ID in=w76, error in=w77) -> (task ID out=w78, error out=w79)
      call "Sound Output Write.gvi"(task ID in=w78, data=w74, error in=w79) -> (task ID out=w80, error out=w81)
      call "Sound Output Start.gvi"(task ID in=w80, error in=w81) -> (task ID out=w82, error out=w83)
      call "Sound Output Wait.gvi"(task ID in=w82, error in=w83, timeout=50) -> (task ID out=w84, error out=w85)
      call "Sound Output Stop.gvi"(task ID in=w84, error in=w85) -> (task ID out=w86, error out=w87)
      call "Sound Output Clear.gvi"(task ID=w86, error in=w87)
      Polar To Complex(r=w70, theta=0) -> (r * e^(i*theta)=w88)
      w89 = cluster{"t0": timestamp, "dt": f64, "Y": c128[]} {all zero or empty}
      Property Node(instance in=w89, "Y"=w88, "dt"=w21) -> (instance out=w90)
      call "FFT Power Spectrum for 1 Chan (CDB)2.gvi"(time signal=w90) -> (power spectrum=w91)
      $"Power Spectrum of Test Signal (only in test mode)" <- w91
      Polar To Complex(r=w71, theta=0) -> (r * e^(i*theta)=w92)
      w93 = cluster{"t0": timestamp, "dt": f64, "Y": c128[]} {all zero or empty}
      Property Node(instance in=w93, "Y"=w92, "dt"=w21) -> (instance out=w94)
      call "FFT Power Spectrum for 1 Chan (CDB)2.gvi"(time signal=w94) -> (power spectrum=w95)
      $"Power Spectrum of Test Signal /wFBDG (only in test mode)" <- w95
    }
    frame True {
      Path To String(path=w10) -> (string=w96)
      Concatenate Strings(w96, "\\chunk.txt") -> w97
      String To Path(string=w97) -> (path=w98)
      # Reading the original bitstream without error
      # Reading the original bitstream without error
      while {
        Open Or Create Or Replace File(file path (use dialog)=w98) -> (error out=w99)
        call "Is Error.gvi"(error in=w99) -> (is error?=w100)
        Not(x=w100) -> w101
        stop if w101
      }
      w102 = $"HEAR PLUS PRO MAX +"
      while {
        call "Read from Spreadsheet File (DBL).gvi"(file path=w98) -> (all rows=w103)
        Array Index(array=w103) -> (out0[_, 0]=w104)
        case (w102) {
          frame False, Default {
            Divide(x=w104, y=32768) -> w105
            Build Waveform Node(Y=w105) -> (output waveform=w106)
            Build Array(w106) -> w107
            w108 = "Sound Data Format.gtype" {"sample rate (S/s)"=22050, "number of channels"=1, "bits per sample"=16}
            call "Sound Output Configure.gvi"(device ID=0, sound format=w108, number of samples/ch=44100) -> (task ID=w109, error out=w110)
            call "Sound Output Start.gvi"(task ID in=w109, error in=w110) -> (task ID out=w111, error out=w112)
            call "Sound Output Write.gvi"(task ID in=w111, data=w107, error in=w112) -> (task ID out=w113, error out=w114)
            call "Sound Output Start.gvi"(task ID in=w113, error in=w114) -> (task ID out=w115, error out=w116)
            call "Sound Output Wait.gvi"(task ID in=w115, error in=w116, timeout=50) -> (task ID out=w117, error out=w118)
            call "Sound Output Stop.gvi"(task ID in=w117, error in=w118) -> (task ID out=w119, error out=w120)
            call "Sound Output Clear.gvi"(task ID=w119, error in=w120)
          }
          frame True {
            call "FilterBankDynamicGain_EU.gvi"(characteristics=w44, signal=w104) -> (out=w121)
            Divide(x=w121, y=32768) -> w122
            Build Waveform Node(Y=w122) -> (output waveform=w123)
            Build Array(w123) -> w124
            w125 = "Sound Data Format.gtype" {"sample rate (S/s)"=22050, "number of channels"=1, "bits per sample"=16}
            # Playing the sounds
            call "Sound Output Configure.gvi"(device ID=0, sound format=w125, number of samples/ch=44100) -> (task ID=w126, error out=w127)
            call "Sound Output Start.gvi"(task ID in=w126, error in=w127) -> (task ID out=w128, error out=w129)
            call "Sound Output Write.gvi"(task ID in=w128, data=w124, error in=w129) -> (task ID out=w130, error out=w131)
            call "Sound Output Start.gvi"(task ID in=w130, error in=w131) -> (task ID out=w132, error out=w133)
            call "Sound Output Wait.gvi"(task ID in=w132, error in=w133, timeout=50) -> (task ID out=w134, error out=w135)
            call "Sound Output Stop.gvi"(task ID in=w134, error in=w135) -> (task ID out=w136, error out=w137)
            call "Sound Output Clear.gvi"(task ID=w136, error in=w137)
            Polar To Complex(r=w104, theta=0) -> (r * e^(i*theta)=w138)
            w139 = cluster{"t0": timestamp, "dt": f64, "Y": c128[]} {all zero or empty}
            Property Node(instance in=w139, "Y"=w138, "dt"=w21) -> (instance out=w140)
            call "FFT Power Spectrum for 1 Chan (CDB)2.gvi"(time signal=w140) -> (power spectrum=w141)
            $"Power Spectrum of Test Signal" <- w141
            Polar To Complex(r=w121, theta=0) -> (r * e^(i*theta)=w142)
            w143 = cluster{"t0": timestamp, "dt": f64, "Y": c128[]} {all zero or empty}
            Property Node(instance in=w143, "Y"=w142, "dt"=w21) -> (instance out=w144)
            call "FFT Power Spectrum for 1 Chan (CDB)2.gvi"(time signal=w144) -> (power spectrum=w145)
            $"Power Spectrum of Test Signal /wFBDG" <- w145
          }
        }
        Tick Count() -> (timer value=w146)
        $"millisecond timer value" <- w146
        stop if FALSE
      }
    }
  }
  $"actual IQ rate" <- w4
  $"actual carrier frequency" <- w5
  # Binary to decimal conversion
  # Binary to decimal conversion
  call "niUSRP Abort.gvi"(Handle in=w18, error in (no error)=w20) -> (Handle out=w147, Error Out=w148)
  call "niUSRP Close Session.gvi"(handle in=w147, error in=w148) -> (error out=w149)
  call "Simple Error Handler.gvi"(error in=w149)
  $"actual gain (dB)" <- w6
