vi "FSKTxProject.gvi"   [LabVIEW Communications System Design Software 2.0.1]
panel controls:
  "IQ rate": f64 = 31200
  "carrier frequency": f64 = 915000000
  "gain (dB)": f64
  "active antenna": string = "TX1"
  "symbol rate (sym/s)": i32 = 780
  "pulse shaping filter": T2 = "none"
  "adc.m path": path = path "C:\\Users\\Emirhan Garip\\Desktop\\Telecom Umut\\EE3001_FinalProject_EG_IUD\\MATLAB Files"
  "Device names": "niUSRPClass"
panel indicators:
  "actual IQ rate": f64
  "actual carrier frequency": f64
  "actual gain (dB)": f64
  "Baseband Power Spectrum": T1
  "Message Waveform (Binary)": f64[]
  "Graph": c128[]
  "Graph_2": f64[]
  "Graph_3": f64[]
types:
  T1 = cluster{"f0": f64, "df": f64, "magnitude": f64[]}
  T2 = enum{"none", "Raised Cosine", "Root Raised Cos", "Gaussian"}
uses:
  NI::Analysis::Resampling::Upsample (DBL).gvi
  NI::Analysis::Operations::1D Convolution (DBL).gvi
diagram:
  # Running the ADC implementation on MATLAB
  Path To String(path=$"adc.m path") -> (string=w1)
  Concatenate Strings(w1, "\\chunk.txt") -> w2
  String To Path(string=w2) -> (path=w3)
  Delete File Or Folder(path (use dialog)=w3)
  To Double Precision Float(number=$"symbol rate (sym/s)") -> w4
  call "niUSRP Open Tx Session.gvi"(Device names=$"Device names") -> (session handle out=w5, Error Out=w6)
  call "niUSRP Configure Signal.gvi"(session handle=w5, IQ rate=$"IQ rate", carrier frequency=$"carrier frequency", gain=$"gain (dB)", error in (no error)=w6, active antenna=$"active antenna") -> (session handle out=w7, coerced IQ rate=w8, coerced carrier frequency=w9, coerced gain=w10)
  # samples/symbol = upsample factor
  Divide(x=w8, y=w4) -> w11
  To Long Integer(number=w11) -> w12
  call "MT Generate Filter Coefficients.gvi"(pulse shaping filter=$"pulse shaping filter", pulse shaping samples per symbol=w12, modulation type="FSK") -> (pulse shaping filter coefficients=w13)
  Path To String(path=$"adc.m path") -> (string=w14)
  Concatenate Strings(w14, "\\ear_thresholds.txt") -> w15
  String To Path(string=w15) -> (path=w16)
  # Upsampling
  # Pulse Shaping
  while {
    Open Or Create Or Replace File(file path (use dialog)=w16) -> (error out=w17)
    call "Is Error.gvi"(error in=w17) -> (is error?=w18)
    Not(x=w18) -> w19
    Wait(time to wait=100)
    stop if w19
  }
  while {
    call "Read from Spreadsheet File (DBL).gvi"(file path=w16) -> (all rows=w20)
    Array Index(array=w20) -> (out0[_, 0]=w21)
    $Graph_2 <- w21
    Reciprocal(x=w8) -> w22
    Multiply(w21, 2) -> w23
    Decrement(x=w23) -> w24
    call "AddFrameHeader(Real).gvi"(Array in=w24) -> (Array out=w25)
    call "Upsample (DBL).gvi"(input array=w25, upsampling factor=w12) -> (upsampled array=w26)
    call "1D Convolution (DBL).gvi"(x=w26, y=w13) -> (x * y=w27)
    Absolute Value(x=w27) -> w28
    Array Max And Min(array=w28) -> (max value=w29)
    Divide(x=w27, y=w29) -> w30
    call "IIR Filter (DBL).gvi"(x=w30, reverse coefficients=[1, -1], forward coefficients=[1]) -> (filtered x=w31)
    Multiply(5000, w31) -> w32
    Multiply(w32, PiTimes2) -> w33
    Multiply(w33, w22) -> w34
    Polar To Complex(r=1, theta=w34) -> (r * e^(i*theta)=w35)
    w36 = cluster{"t0": timestamp, "dt": f64, "Y": c128[]} {all zero or empty}
    Property Node(instance in=w36, "Y"=w35, "dt"=w22) -> (instance out=w37)
    call "FFT Power Spectrum for 1 Chan (CDB)2.gvi"(time signal=w37, dB On (F)=TRUE) -> (power spectrum=w38, Error Out=w39)
    call "niUSRP Write Tx Data (CDB).gvi"(session handle=w7, data=w35, timeout=5, error in (no error)=w39) -> (session handle out=w40, Error Out=w41)
    $"actual IQ rate" <- w8
    $Graph_3 <- w21
    $Graph <- w35
    $"actual carrier frequency" <- w9
    $"actual gain (dB)" <- w10
    $"Baseband Power Spectrum" <- w38
    $"Message Waveform (Binary)" <- w24
    stop if FALSE
  }
  call "niUSRP Close Session.gvi"(handle in=w40, error in=w41) -> (error out=w42)
  call "Simple Error Handler.gvi"(error in=w42)
  # Deleting the existing files first
  Path To String(path=$"adc.m path") -> (string=w43)
  Concatenate Strings(w43, "\\ear_thresholds.txt") -> w44
  String To Path(string=w44) -> (path=w45)
  Delete File Or Folder(path (use dialog)=w45)
  call "System Exec.gvi"(command line="matlab -r \"heaaare\" ", working directory=$"adc.m path", run minimized?=TRUE)
  Path To String(path=$"adc.m path") -> (string=w46)
  Concatenate Strings(w46, "\\ear_thresholds2.txt") -> w47
  String To Path(string=w47) -> (path=w48)
  Delete File Or Folder(path (use dialog)=w48)
