vi "FilterBankDynamicGain_EU.gvi"   [LabVIEW Communications System Design Software 2.0.1]
inputs:
  "characteristics": f64[]
  "signal": f64[]
outputs:
  "out": f64[]
diagram:
  Array Index(array=$characteristics) -> (out0[10]=w1)
  call "FIR Windowed Bandpass Filter (DBL).gvi"(sampling frequency=36000, low cutoff frequency=8500, high cutoff frequency=10900, signal=$signal) -> (filtered signal=w2)
  Multiply(w2, w1) -> w3
  Array Index(array=$characteristics) -> (out0[11]=w4)
  call "FIR Windowed Bandpass Filter (DBL).gvi"(sampling frequency=36000, low cutoff frequency=11000, high cutoff frequency=14000, signal=$signal) -> (filtered signal=w5)
  Multiply(w5, w4) -> w6
  Add(w3, w6) -> w7
  Array Index(array=$characteristics) -> (out0[5]=w8)
  call "FIR Windowed Bandpass Filter (DBL).gvi"(sampling frequency=36000, low cutoff frequency=900, high cutoff frequency=1300, signal=$signal) -> (filtered signal=w9)
  Multiply(w9, w8) -> w10
  Array Index(array=$characteristics) -> (out0[6]=w11)
  call "FIR Windowed Bandpass Filter (DBL).gvi"(sampling frequency=36000, low cutoff frequency=1400, high cutoff frequency=1696, signal=$signal) -> (filtered signal=w12)
  Multiply(w12, w11) -> w13
  Add(w10, w13) -> w14
  Array Index(array=$characteristics) -> (out0[7]=w15)
  call "FIR Windowed Bandpass Filter (DBL).gvi"(sampling frequency=36000, low cutoff frequency=1800, high cutoff frequency=3200, signal=$signal) -> (filtered signal=w16)
  Multiply(w16, w15) -> w17
  Array Index(array=$characteristics) -> (out0[8]=w18)
  call "FIR Windowed Bandpass Filter (DBL).gvi"(sampling frequency=36000, low cutoff frequency=3500, high cutoff frequency=4900, signal=$signal) -> (filtered signal=w19)
  Multiply(w19, w18) -> w20
  Add(w17, w20) -> w21
  Add(w14, w21) -> w22
  Array Index(array=$characteristics) -> (out0[0]=w23)
  call "FIR Windowed Bandpass Filter (DBL).gvi"(sampling frequency=36000, low cutoff frequency=20, high cutoff frequency=60, signal=$signal) -> (filtered signal=w24)
  Multiply(w24, w23) -> w25
  Array Index(array=$characteristics) -> (out0[1]=w26)
  call "FIR Windowed Bandpass Filter (DBL).gvi"(sampling frequency=36000, low cutoff frequency=80, high cutoff frequency=140, signal=$signal) -> (filtered signal=w27)
  Multiply(w27, w26) -> w28
  Add(w25, w28) -> w29
  Array Index(array=$characteristics) -> (out0[2]=w30)
  call "FIR Windowed Bandpass Filter (DBL).gvi"(sampling frequency=36000, low cutoff frequency=180, high cutoff frequency=320, signal=$signal) -> (filtered signal=w31)
  Multiply(w31, w30) -> w32
  Array Index(array=$characteristics) -> (out0[3]=w33)
  call "FIR Windowed Bandpass Filter (DBL).gvi"(sampling frequency=36000, low cutoff frequency=350, high cutoff frequency=650, signal=$signal) -> (filtered signal=w34)
  Multiply(w34, w33) -> w35
  Add(w32, w35) -> w36
  Add(w29, w36) -> w37
  Array Index(array=$characteristics) -> (out0[4]=w38)
  call "FIR Windowed Bandpass Filter (DBL).gvi"(sampling frequency=36000, low cutoff frequency=700, high cutoff frequency=900, signal=$signal) -> (filtered signal=w39)
  Multiply(w39, w38) -> w40
  Array Index(array=$characteristics) -> (out0[9]=w41)
  call "FIR Windowed Bandpass Filter (DBL).gvi"(sampling frequency=36000, low cutoff frequency=5000, high cutoff frequency=8000, signal=$signal) -> (filtered signal=w42)
  Multiply(w42, w41) -> w43
  Add(w43, w40) -> w44
  Add(w37, w44) -> w45
  Add(w22, w45) -> w46
  Array Index(array=$characteristics) -> (out0[12]=w47)
  call "FIR Windowed Bandpass Filter (DBL).gvi"(sampling frequency=36000, low cutoff frequency=14500, high cutoff frequency=17000, signal=$signal) -> (filtered signal=w48)
  Multiply(w48, w47) -> w49
  Add(w49, w46) -> w50
  Add(w7, w50) -> w51
  $out <- w51
