vi "AddFrameHeader(Real).gvi"   [LabVIEW NXG]
inputs:
  "Array in": f64[]
outputs:
  "Array out": f64[]
diagram:
  # 13-bit Barker code, repeated
  Build Array[ConcatenateInputs=True]([1, 1, 1, 1, 1, -1, -1, 1, 1, -1, 1, -1, 1], [1, 1, 1, 1, 1, -1, -1, 1, 1, -1, 1, -1, 1]) -> w1
  Insert Into Array(inArray=$"Array in", index0=0, new=w1) -> w2
  $"Array out" <- w2
