vi "FIR Windowed Bandpass Filter (DBL).gvi"   [LabVIEW Communications System Design Suite 2.0.1]
inputs:
  "sampling frequency": f64 = 1
  "low cutoff frequency": f64 = 0.125
  "high cutoff frequency": f64 = 0.45
  "signal": f64[], required
  "error in": error
  "window parameter": f64 = NaN
  "number of taps": i32 = 25
  "window type": "windowTd.gtype" = "Rectangle"(0)
  "reset": bool
outputs:
  "filtered signal": f64[]
  "error out": error
types:
  "windowTd.gtype" = u32
uses:
  NI::Analysis::Filtering::FIR Windowed Filter Design with State.gvi
  NI::Analysis::Filtering::Filtering (DBL).gvi
diagram:
  call "FIR Windowed Filter Design with State.gvi"(filter type="Bandpass", sampling frequency=$"sampling frequency", number of taps=$"number of taps", window type=$"window type", high cutoff frequency=$"high cutoff frequency", window parameter=$"window parameter", low cutoff frequency=$"low cutoff frequency", error in=$"error in") -> (filter=w1, error out=w2)
  call "Filtering (DBL).gvi"(signal=$signal, filter=w1, error in=w2, reset=$reset) -> (filtered signal=w3, error out=w4)
  $"filtered signal" <- w3
  $"error out" <- w4
