vi "IIR Filter (DBL).gvi"   [LabVIEW Communications System Design Suite 2.0.1]
inputs:
  "x": f64[]
  "reverse coefficients": f64[]
  "forward coefficients": f64[]
  "init?": bool
outputs:
  "filtered x": f64[]
  "error": i32
types:
  "filter structure.gtype" = u32
  "filter.gtype" = cluster{"filter structure": "filter structure.gtype", "forward coefficients": f64[], "reverse coefficients": f64[], "sampling frequency": f64}
uses:
  NI::Analysis::Filtering::Filtering (DBL).gvi
diagram:
  Not(x=$"init?") -> w1
  Property Node(instance in="filter.gtype" {all zero or empty}, "filter structure"="IIR Direct"(2), "forward coefficients"=$"forward coefficients", "reverse coefficients"=$"reverse coefficients", "sampling frequency"=1) -> (instance out=w2)
  call "Filtering (DBL).gvi"(signal=$x, filter=w2, reset=w1) -> (filtered signal=w3, error out=w4)
  $"filtered x" <- w3
  Property Node(instance in=w4) -> ("code"=w5)
  $error <- w5
