vi "PulseAlign(real).gvi"   [LabVIEW NXG]
inputs:
  "Input Signal": cluster{"t0": f64, "dt": f64, "Y": f64[]}
  "Receiver Sampling Factor": i32 = 100
  "error in (no error)": error
outputs:
  "Aligned Signal": cluster{"t0": f64, "dt": f64, "Y": f64[]}
  "alignment offset (samples)": i32
  "error out": error
panel indicators:
  "Objective Function": f64[]
diagram:
  Property Node(instance in=$"Input Signal") -> ("Y"=w1)
  call "Mean (DBL).gvi"(X=w1) -> (mean=w2)
  Subtract(x=w1, y=w2) -> w3
  for (N = $"Receiver Sampling Factor") (iteration -> i1) {
    Array Subset(array=w3, index0=i1) -> w5
    call "Decimate (single shot, DBL).gvi"(x=w5, decimating factor=$"Receiver Sampling Factor") -> (decimated array=w6)
    Square(x=w6) -> w7
    Add Array Elements(numeric array=w7) -> (sum=w8)
    append w8 to w4
  }
  Array Max And Min(array=w4) -> (max index(es)=w9)
  Array Subset(array=w1, index0=w9) -> w10
  Property Node(instance in=$"Input Signal", "Y"=w10) -> (instance out=w11)
  $"Aligned Signal" <- w11
  $"Objective Function" <- w4
  $"alignment offset (samples)" <- w9
  $"error out" <- $"error in (no error)"
