vi "Threshold Detector.gvi"   [LabVIEW Communications System Design Suite 2.0.1]
inputs:
  "error in": error
  "signal": f64[], required
  "threshold": f64
  "width": i32 = 1
outputs:
  "error out": error
  "indices": i32[]
  "count": i32
uses:
  NI::Analysis::Measurement::AAL Measurement.sli::PeakDetector
  NI::Analysis::Support::aal_Error Cluster from Error Code.gvi
diagram:
  call "PeakDetector"(xHandle in=$signal, threshold in=$threshold, width in=$width, count in=0, error_2 in=0, error in=$"error in") -> (pHandle out=w1, count out=w2, error_2 out=w3, error out=w4)
  call "aal_Error Cluster from Error Code.gvi"(error code=w3, error in=w4, error message="Threshold Detector.gvi") -> (error out=w5)
  $"error out" <- w5
  $indices <- w1
  $count <- w2
